# Grasshopper definition cobertura_ameboide.ghx (Grasshopper 0.9.76)

number_slider = Slider(-7.327, range=-15..5)
pt = ConstructPoint(XCoordinate=Slider(0, range=0..20), YCoordinate=number_slider, ZCoordinate=Slider(4.346, range=0..20))
pt_2 = ConstructPoint(XCoordinate=Slider(6.33, range=0..20), YCoordinate=number_slider, ZCoordinate=Slider(3.52, range=0..20))
pt_3 = ConstructPoint(XCoordinate=Slider(11.25, range=0..20), YCoordinate=number_slider, ZCoordinate=Slider(4.776, range=0..20))
pt_4 = ConstructPoint(XCoordinate=Slider(0, range=0..20), YCoordinate=20, ZCoordinate=Slider(3.732, range=0..20))
pt_5 = ConstructPoint(XCoordinate=Slider(19.65, range=0..20), YCoordinate=number_slider, ZCoordinate=Slider(5.09, range=0..20))
pt_6 = ConstructPoint(XCoordinate=Slider(7.29, range=0..20), YCoordinate=20, ZCoordinate=Slider(3.706, range=0..20))
pt_7 = ConstructPoint(XCoordinate=Slider(12.85, range=0..20), YCoordinate=20, ZCoordinate=Slider(3.914, range=0..20))
pt_8 = ConstructPoint(XCoordinate=Slider(19.65, range=0..20), YCoordinate=20, ZCoordinate=Slider(5.235, range=0..20))

pt_9 = ConstructPoint(XCoordinate=Slider(7.322, range=0..20), YCoordinate=Slider(4.962, range=0..20), ZCoordinate=0)
pt_10 = ConstructPoint(XCoordinate=Slider(14.904, range=0..20), YCoordinate=Slider(9.997, range=0..20), ZCoordinate=0)
pt_11 = ConstructPoint(XCoordinate=Slider(0.684, range=0..20), YCoordinate=Slider(1.348, range=0..20), ZCoordinate=0)
pt_12 = ConstructPoint(XCoordinate=Slider(17.789, range=0..20), YCoordinate=Slider(1.514, range=0..20), ZCoordinate=0)
pt_13 = ConstructPoint(XCoordinate=Slider(1.69, range=0..20), YCoordinate=Slider(6.546, range=0..20), ZCoordinate=0)

numero_de_laminas = Slider(24, range=1..50)
intcrv = Interpolate(Vertices=[pt, pt_2, pt_3, pt_5], Degree=3, Periodic=False, KnotStyle=1)  # -> Curve, Length, Domain
intcrv_2 = Interpolate(Vertices=[pt_4, pt_6, pt_7, pt_8], Degree=3, Periodic=False, KnotStyle=1)  # -> Curve, Length, Domain
intcrv_3 = Interpolate(Vertices=[pt_11, pt_13, pt_9, pt_10, pt_12], Degree=3, Periodic=True, KnotStyle=1)  # -> Curve, Length, Domain
pline = PolyLine(Vertices=[pt_13, pt_9, pt_10, pt_12, pt_11], Closed=True)
rulesrf = RuledSurface(CurveA=intcrv.Curve, CurveB=intcrv_2.Curve)
offset = Offset(Curve=intcrv_3.Curve, Distance=1, Plane=PlaneXY(0, 0, 0), Corners=1)
project = Project(Curve=intcrv_3.Curve, Brep=rulesrf, Direction=Vector(0, 0, 1))
patch = Patch(Curves=project, Spans=20, Flexibility=1, Trim=True)
project_2 = Project(Curve=offset, Brep=patch, Direction=Vector(0, 0, 1))
range = Range(Domain=Domain(0, 20), Steps=numero_de_laminas)
pt_14 = ConstructPoint(XCoordinate=0, YCoordinate=20, ZCoordinate=0)
pt_15 = ConstructPoint(XCoordinate=0, YCoordinate=-10, ZCoordinate=0)
rulesrf_2 = RuledSurface(CurveA=offset, CurveB=project_2)
X = UnitX(Factor=range)
ln = Line(StartPoint=pt_15, EndPoint=pt_14)
random = Random(Range=Domain(-0.09, 0.09), Number=25, Seed=2)
move = Move(Geometry=ln, Motion=X)  # -> Geometry, Transform
rotate = Rotate(Geometry=move.Geometry, Angle=random, Plane=PlaneXY(0, 0, 0))  # -> Geometry, Transform
number_slider_2 = Slider(0.03, range=0..1)
project_3 = Project(Curve=rotate.Geometry, Brep=patch, Direction=Vector(0, 0, 1))
xz = XZPlane(Origin=Point(0, 0, 0))
dom = ConstructDomain(DomainStart=expr("-x", number_slider_2), DomainEnd=number_slider_2)
rectangle = Rectangle(Plane=xz, XSize=dom, YSize=Slider(-0.441, range=-0.5..-0.1), Radius=0)  # -> Rectangle, Length
divide = DivideCurve(Curve=project_3, Count=1, Kinks=False)  # -> Points, Tangents, Parameters
extrcrv = ExtrudeAlong(Base=rectangle.Rectangle, Curve=project_3)
culln = CullNth(List=divide.Points, CullFrequency=2)
pt_16 = ConstructPoint(XCoordinate=0, YCoordinate=0, ZCoordinate=0)
vec2pt = Vector2Pt(PointA=pt_16, PointB=culln, Unitize=False)  # -> Vector, Length
move_2 = Move(Geometry=extrcrv, Motion=vec2pt.Vector)  # -> Geometry, Transform
md_slider = MDSlider(
    slider_value=Point(0.765519305, 0.4532924745, 0.5),
    SliderMode=0,
    x_domain=Domain(-20, 20),
    y_domain=Domain(-20, 20),
    z_domain=Domain(0, 1))
rotate_2 = Rotate(Geometry=[move_2.Geometry, patch], Angle=3.141592654, Plane=PlaneXY(0, 0, 0))  # -> Geometry, Transform
move_3 = Move(Geometry=rotate_2.Geometry, Motion=md_slider)  # -> Geometry, Transform
