# Grasshopper definition ground.gh (Grasshopper 0.9.76)
# plug-ins: SpaceSyntaxDesign_GH

panel = Panel("""Execução
Marcenaria
Sala de Fotografia
Depósito
I.S.F. e M.
Marquise
Hall
Canteiro Experimental
Cozinha Comunitária""")
crv = Curve(<curve referenced from the Rhino model>)
genes = GenePool(Decimals=0, Maximum=80, Minimum=1, Value=[80, 30, 15, 15, 15, 40, 40, 15, 20])
area = Area(Geometry=crv)  # -> Area, Centroid
multiplication = Multiplication(A=area.Area, B=100)
panel_2 = Panel(multiplication)
crv_2 = Curve([<curve referenced from the Rhino model> x11])
pt = Point([<point referenced from the Rhino model> x9])
ma = MassAddition(Input=genes)  # -> Result, PartialResults
division = Division(A=ma.Result, B=100)
multiplication_2 = Multiplication(A=division, B=100)
panel_3 = Panel(multiplication_2)
nodelinkgraph = GraphFromNodesLinks(Points=pt, Links=crv_2, Labels=panel, Areas=genes, TotalArea=division)  # -> Graph, GraphVertices, Attributes
forcedirecteddrawing = ForceDirectedDrawing(
    Graph=nodelinkgraph.Graph,
    Vertices=nodelinkgraph.GraphVertices,
    Attributes=nodelinkgraph.Attributes,
    AttractionStrength=0.25,
    RepulsionStrength=1.4,
    ConvergenceTolearnce=0.001,
    MaximumIterations=4000,
    Active=True)  # -> NewGraphVertices, IterationCount
diskograph = DiskoGraphDrawing(
    Plane=PlaneXY(0, 0, 0),
    Graph=nodelinkgraph.Graph,
    Vertices=forcedirecteddrawing.NewGraphVertices,
    Attributes=nodelinkgraph.Attributes,
    Thickness=1)
