# Grasshopper definition ground_diagram_adriely.gh (Grasshopper 0.9.76)
# plug-ins: SpaceSyntaxDesign_GH

crv = Curve(<curve referenced from the Rhino model>)
panel = Panel("""Execução Principal
Execução Secundária
Marcenaria
Sala de Fotografia
Depósito
Cozinha Comunitária
I.S.F. e M.
Hall
Canteiro Experimental
Marquise""")
area = Area(Geometry=crv)  # -> Area, Centroid
multiplication = Multiplication(A=area.Area, B=100)
genes = GenePool(Decimals=0, Maximum=80, Minimum=1, Value=[50, 50, 40, 10, 20, 10, 25, 35, 25, 30])
panel_2 = Panel(multiplication)
crv_2 = Curve([<curve referenced from the Rhino model> x14])
pt = Point([<point referenced from the Rhino model> x10])
ma = MassAddition(Input=genes)  # -> Result, PartialResults
division = Division(A=ma.Result, B=100)
multiplication_2 = Multiplication(A=division, B=100)
panel_3 = Panel(multiplication_2)
metaball_t = MetaBallT(Plane=PlaneXY(0, 0, 0), Threshold=0.5)
nodelinkgraph = GraphFromNodesLinks(Points=pt, Links=crv_2, Labels=panel, Areas=genes, TotalArea=division)  # -> Graph, GraphVertices, Attributes
forcedirecteddrawing = ForceDirectedDrawing(
    Graph=nodelinkgraph.Graph,
    Vertices=nodelinkgraph.GraphVertices,
    Attributes=nodelinkgraph.Attributes,
    AttractionStrength=0.25,
    RepulsionStrength=1.4,
    ConvergenceTolearnce=0.001,
    MaximumIterations=4000,
    Active=True)  # -> NewGraphVertices, IterationCount
diskograph = DiskoGraphDrawing(
    Plane=PlaneXY(0, 0, 0),
    Graph=nodelinkgraph.Graph,
    Vertices=forcedirecteddrawing.NewGraphVertices,
    Attributes=nodelinkgraph.Attributes,
    Thickness=1)
