# Grasshopper definition shed_solar.ghx (Grasshopper 0.9.76)

# ---- group: Setor de instalações
posição_do_bloco_da_direita_instalações = Slider(29, range=0..50)
ponto_de_origem = Slider(0, range=0..30)
number_slider = Slider(-23, range=-50..0)

# ----
profundidade_do_hall = Slider(22.251, range=3..50)

# ---- group: Setor de instalações / Segundo bloco
number_slider_2 = Slider(3, range=0..20)
number_slider_3 = Slider(5, range=0..20)

# ---- group: Setor de instalações / Terceiro bloco
number_slider_4 = Slider(5, range=0..20)
number_slider_5 = Slider(3, range=0..20)

# ---- group: Setor de instalações / Primeiro bloco
number_slider_6 = Slider(5, range=0..20)
number_slider_7 = Slider(3, range=0..20)

# ---- group: Setor de instalações / Quarto bloco
number_slider_8 = Slider(8, range=0..20)
number_slider_9 = Slider(7, range=0..20)

# ---- group: Parede central
parede_central_reta_ou_curva = BooleanToggle(True)
number_slider_10 = Slider(-7, range=-20..0)
altura = Slider(2, range=2..8)
md_slider = MDSlider(
    slider_value=Point(0.1241490143, 0.2990209967, 0.5),
    SliderMode=0,
    x_domain=Domain(0, 10),
    y_domain=Domain(0, 40),
    z_domain=Domain(0, 1))
md_slider_2 = MDSlider(
    slider_value=Point(0.6711363095, 0.1267948716, 0.5),
    SliderMode=0,
    x_domain=Domain(-10, 10),
    y_domain=Domain(0, 40),
    z_domain=Domain(0, 1))
md_slider_3 = MDSlider(
    slider_value=Point(0.08151321586, 0.1082026729, 0.5),
    SliderMode=0,
    x_domain=Domain(0, 10),
    y_domain=Domain(0, 40),
    z_domain=Domain(0, 1))

# ---- group: Execução
secundária = MDSlider(
    slider_value=Point(0.8994790173, 0.2880299483, 0.5),
    SliderMode=0,
    x_domain=Domain(-50, -5),
    y_domain=Domain(0, 50),
    z_domain=Domain(0, 1))
principal = MDSlider(
    slider_value=Point(0.9290073615, 0, 0.5),
    SliderMode=0,
    x_domain=Domain(-50, -10),
    y_domain=Domain(0, 50),
    z_domain=Domain(0, 1))
rotação = ControlKnob(Decimals=2, Limit=True, Maximum=1, Minimum=0, Range=1, Value=0.05)

# ----
addition = Addition(A=posição_do_bloco_da_direita_instalações, B=number_slider)
pt = ConstructPoint(XCoordinate=ponto_de_origem, YCoordinate=0, ZCoordinate=0)

# ---- group: Instalações (em planta)
addition_2 = Addition(A=ponto_de_origem, B=number_slider_3)
addition_3 = Addition(A=addition, B=number_slider_7)
addition_4 = Addition(A=addition_3, B=number_slider_2)
addition_5 = Addition(A=ponto_de_origem, B=number_slider_6)
addition_6 = Addition(A=ponto_de_origem, B=number_slider_4)
addition_7 = Addition(A=addition_4, B=number_slider_5)
addition_8 = Addition(A=ponto_de_origem, B=number_slider_8)
addition_9 = Addition(A=addition_7, B=number_slider_9)
pt_2 = ConstructPoint(XCoordinate=addition_5, YCoordinate=addition_3, ZCoordinate=0)
pt_3 = ConstructPoint(XCoordinate=ponto_de_origem, YCoordinate=addition, ZCoordinate=0)
pt_4 = ConstructPoint(XCoordinate=ponto_de_origem, YCoordinate=addition_3, ZCoordinate=0)
pt_5 = ConstructPoint(XCoordinate=addition_2, YCoordinate=addition_4, ZCoordinate=0)
pt_6 = ConstructPoint(XCoordinate=ponto_de_origem, YCoordinate=addition_4, ZCoordinate=0)
pt_7 = ConstructPoint(XCoordinate=addition_6, YCoordinate=addition_7, ZCoordinate=0)
pt_8 = ConstructPoint(XCoordinate=ponto_de_origem, YCoordinate=addition_7, ZCoordinate=0)
pt_9 = ConstructPoint(XCoordinate=addition_8, YCoordinate=addition_9, ZCoordinate=0)
rec_2pt = Rectangle2Pt(Plane=PlaneXY(0, 0, 0), PointA=pt_4, PointB=pt_5, Radius=0)  # -> Rectangle, Length
rec_2pt_2 = Rectangle2Pt(Plane=PlaneXY(0, 0, 0), PointA=pt_3, PointB=pt_2, Radius=0)  # -> Rectangle, Length
rec_2pt_3 = Rectangle2Pt(Plane=PlaneXY(0, 0, 0), PointA=pt_8, PointB=pt_9, Radius=0)  # -> Rectangle, Length
rec_2pt_4 = Rectangle2Pt(Plane=PlaneXY(0, 0, 0), PointA=pt_6, PointB=pt_7, Radius=0)  # -> Rectangle, Length

# ---- group: Parede divisória central
X = UnitX(Factor=number_slider_10)
move = Move(Geometry=pt, Motion=X)  # -> Geometry, Transform
move_2 = Move(Geometry=move.Geometry, Motion=md_slider_3)  # -> Geometry, Transform
move_3 = Move(Geometry=move_2.Geometry, Motion=md_slider_2)  # -> Geometry, Transform
move_4 = Move(Geometry=move_3.Geometry, Motion=md_slider)  # -> Geometry, Transform
pdecon = Deconstruct(Point=move_4.Geometry)  # -> XComponent, YComponent, ZComponent
p_n_c = PickNChoose(Pattern=parede_central_reta_ou_curva, Stream0=1, Stream1=3)
intcrv = Interpolate(Vertices=[move.Geometry, move_2.Geometry, move_3.Geometry, move_4.Geometry], Degree=p_n_c, Periodic=False, KnotStyle=1)  # -> Curve, Length, Domain
Z = UnitZ(Factor=altura)
extr = Extrude(Base=intcrv.Curve, Direction=Z)

# ---- group: Hall
min = Minimum(A=profundidade_do_hall, B=pdecon.YComponent)
pt_10 = ConstructPoint(XCoordinate=-50, YCoordinate=min, ZCoordinate=0)
rec_2pt_5 = Rectangle2Pt(Plane=PlaneXY(0, 0, 0), PointA=Point(0, 0, 0), PointB=pt_10, Radius=0)  # -> Rectangle, Length
srfsplit = SurfaceSplit(Surface=rec_2pt_5.Rectangle, Curves=intcrv.Curve)
rev = ReverseList(List=srfsplit)
item = CherryPicker(rev, ListIndex=0, TreePath_path="{0;0}")

# ---- group: Execução
rec_2pt_6 = Rectangle2Pt(Plane=PlaneXY(0, 0, 0), PointA=Point(0, 0, 0), PointB=secundária, Radius=0)  # -> Rectangle, Length
rec_2pt_7 = Rectangle2Pt(Plane=PlaneXY(0, 0, 0), PointA=secundária, PointB=principal, Radius=0)  # -> Rectangle, Length
rotate = Rotate(Geometry=rec_2pt_6.Rectangle, Angle=expr("-2*pi*x", rotação), Plane=PlaneXY(0, 0, 0))  # -> Geometry, Transform
rotate_2 = Rotate(Geometry=rec_2pt_7.Rectangle, Angle=expr("-2*pi*x", rotação), Plane=PlaneXY(0, 0, 0))  # -> Geometry, Transform
srfsplit_2 = SurfaceSplit(Surface=rotate.Geometry, Curves=intcrv.Curve)
item_2 = CherryPicker(srfsplit_2, ListIndex=0)

# ---- group: Linhas que geram a cobertura
number_slider_11 = Slider(2.883, range=2..5)
number_slider_12 = Slider(1, range=1..5)
number_slider_13 = Slider(2, range=2..5)
number_slider_14 = Slider(3.452, range=2..5)
number_slider_15 = Slider(2, range=2..5)
number_slider_16 = Slider(2.693, range=2..5)

# ---- group: Cobertura da área de instalações
panel = Panel([addition_2, addition_6, addition_5, addition_8])
runion = RegionUnion(Curves=[rec_2pt_2.Rectangle, rec_2pt.Rectangle, rec_2pt_4.Rectangle, rec_2pt_3.Rectangle])
sort = SortList(Keys=panel)  # -> Keys, ValuesA
rev_2 = ReverseList(List=sort.Keys)
item_3 = CherryPicker(rev_2, ListIndex=0)
subtraction = Subtraction(A=item_3, B=ponto_de_origem)
Z_2 = UnitZ(Factor=number_slider_11)
Z_3 = UnitZ(Factor=number_slider_13)
Z_4 = UnitZ(Factor=number_slider_12)
Z_5 = UnitZ(Factor=number_slider_15)
Z_6 = UnitZ(Factor=number_slider_14)
Z_7 = UnitZ(Factor=number_slider_16)
division = Division(A=subtraction, B=2)
pt_11 = ConstructPoint(XCoordinate=item_3, YCoordinate=posição_do_bloco_da_direita_instalações, ZCoordinate=Z_3)
pt_12 = ConstructPoint(XCoordinate=ponto_de_origem, YCoordinate=posição_do_bloco_da_direita_instalações, ZCoordinate=Z_2)
pt_13 = ConstructPoint(XCoordinate=ponto_de_origem, YCoordinate=0, ZCoordinate=Z_7)
pt_14 = ConstructPoint(XCoordinate=item_3, YCoordinate=0, ZCoordinate=Z_5)
addition_10 = Addition(A=ponto_de_origem, B=division)
pt_15 = ConstructPoint(XCoordinate=addition_10, YCoordinate=posição_do_bloco_da_direita_instalações, ZCoordinate=Z_4)
pt_16 = ConstructPoint(XCoordinate=addition_10, YCoordinate=0, ZCoordinate=Z_6)
intcrv_2 = Interpolate(Vertices=[pt_12, pt_15, pt_11], Degree=3, Periodic=False, KnotStyle=1)  # -> Curve, Length, Domain
intcrv_3 = Interpolate(Vertices=[pt_13, pt_16, pt_14], Degree=3, Periodic=False, KnotStyle=1)  # -> Curve, Length, Domain
rulesrf = RuledSurface(CurveA=intcrv_3.Curve, CurveB=intcrv_2.Curve)
project = Project(Curve=runion, Brep=rulesrf, Direction=Vector(0, 0, 1))
patch = Patch(Curves=project, Spans=20, Flexibility=1, Trim=True)

# ----
number_slider_17 = Slider(0.018, range=0..0.1)
knob = ControlKnob(Decimals=2, Limit=True, Maximum=1, Minimum=0, Range=1, Value=0.04)

rgb = ColourRGB(Alpha=255, Red=0, Green=0, Blue=255)

# ---- group: Cobertura do hall
pt_17 = ConstructPoint(XCoordinate=0, YCoordinate=Slider(-3.334, range=-10..70), ZCoordinate=Slider(2.81, range=0..10))
pt_18 = ConstructPoint(XCoordinate=0, YCoordinate=Slider(4.858, range=-10..70), ZCoordinate=Slider(4.026, range=0..10))
pt_19 = ConstructPoint(XCoordinate=0, YCoordinate=Slider(13.562, range=-10..70), ZCoordinate=Slider(2.904, range=0..10))
pt_20 = ConstructPoint(XCoordinate=0, YCoordinate=Slider(22.737, range=-10..70), ZCoordinate=Slider(2.535, range=0..10))
p_n_c_2 = PickNChoose(Pattern=Toggle(True), Stream0=1, Stream1=3)
X_2 = UnitX(Factor=expr("x-2", number_slider_10))
intcrv_4 = Interpolate(Vertices=[pt_17, pt_18, pt_19, pt_20], Degree=p_n_c_2, Periodic=False, KnotStyle=1)  # -> Curve, Length, Domain
extr_2 = Extrude(Base=intcrv_4.Curve, Direction=X_2)
range = Range(Domain=Slider(-7.814, range=-20..1), Steps=Slider(60, range=0..60))
rotate_3 = Rotate(Geometry=extr_2, Angle=expr("-2*Pi*x", knob), Plane=PlaneXY(0, 0, 0))  # -> Geometry, Transform
rotate_4 = Rotate(Geometry=intcrv_4.Curve, Angle=expr("-2*Pi*x", knob), Plane=PlaneXY(0, 0, 0))  # -> Geometry, Transform
X_3 = UnitX(Factor=range)
project_2 = Project(Curve=item, Brep=rotate_3.Geometry, Direction=Vector(0, 0, 1))
patch_2 = Patch(Curves=project_2, Spans=20, Flexibility=1, Trim=True)
move_5 = Move(Geometry=rotate_4.Geometry, Motion=X_3)  # -> Geometry, Transform
xz = XZPlane(Origin=Point(0, 0, 0))
dom = ConstructDomain(DomainStart=number_slider_17, DomainEnd=expr("-x", number_slider_17))
dom_2 = ConstructDomain(DomainStart=0, DomainEnd=expr("-x", Slider(0.157, range=0..0.4)))
project_3 = Project(Curve=move_5.Geometry, Brep=patch_2, Direction=Vector(0, 0, 1))
rectangle = Rectangle(Plane=xz, XSize=dom, YSize=dom_2, Radius=0)  # -> Rectangle, Length
end = EndPoints(Curve=project_3)  # -> Start, End
pt_21 = ConstructPoint(XCoordinate=0, YCoordinate=0, ZCoordinate=0)
extrcrv = ExtrudeAlong(Base=rectangle.Rectangle, Curve=project_3)
vec2pt = Vector2Pt(PointA=pt_21, PointB=end.Start, Unitize=False)  # -> Vector, Length
move_6 = Move(Geometry=extrcrv, Motion=vec2pt.Vector)  # -> Geometry, Transform

# ---- group: Nomes e áreas
area = Area(Geometry=item)  # -> Area, Centroid
area_2 = Area(Geometry=rec_2pt_3.Rectangle)  # -> Area, Centroid
area_3 = Area(Geometry=rec_2pt_4.Rectangle)  # -> Area, Centroid
area_4 = Area(Geometry=rec_2pt.Rectangle)  # -> Area, Centroid
area_5 = Area(Geometry=rotate_2.Geometry)  # -> Area, Centroid
area_6 = Area(Geometry=item_2)  # -> Area, Centroid
area_7 = Area(Geometry=rec_2pt_2.Rectangle)  # -> Area, Centroid
round = Round(Number=area.Area)  # -> Nearest, Floor, Ceiling
round_2 = Round(Number=area_2.Area)  # -> Nearest, Floor, Ceiling
round_3 = Round(Number=area_3.Area)  # -> Nearest, Floor, Ceiling
round_4 = Round(Number=area_4.Area)  # -> Nearest, Floor, Ceiling
round_5 = Round(Number=area_5.Area)  # -> Nearest, Floor, Ceiling
round_6 = Round(Number=area_6.Area)  # -> Nearest, Floor, Ceiling
round_7 = Round(Number=area_7.Area)  # -> Nearest, Floor, Ceiling
concat = Concatenate(FragmentA=round_2.Nearest, FragmentB=" m2 (marcenaria)")
concat_2 = Concatenate(FragmentA=round_3.Nearest, FragmentB=" m2 (cozinha)")
concat_3 = Concatenate(FragmentA=round_4.Nearest, FragmentB=" m2 (i.s.m.)")
concat_4 = Concatenate(FragmentA=round.Nearest, FragmentB=" m2 (hall)")
concat_5 = Concatenate(FragmentA=round_5.Nearest, FragmentB=" m2 (exec. principal)")
concat_6 = Concatenate(FragmentA=round_6.Nearest, FragmentB=" m2 (exec. secundária)")
concat_7 = Concatenate(FragmentA=round_7.Nearest, FragmentB=" m2 (i.s.f.)")

# ---- group: Cobertura da parte de execução
sunion = SolidUnion(Breps=[item_2, rotate_2.Geometry])
disc = Discontinuity(Curve=sunion, Level=1)  # -> graft(Points), Parameters
item_4 = CherryPicker(disc.Points, ListIndex=0, TreePath_path="{0;0;0}")
item_5 = CherryPicker(disc.Points, ListIndex=0, TreePath_path="{0;0;3}")
ln = Line(StartPoint=item_4, EndPoint=item_5)
divide = DivideCurve(Curve=ln, Count=Slider(28, range=0..50), Kinks=False)  # -> graft(Points), Tangents, Parameters
vec = VectorXYZ(XComponent=Slider(-1.022, range=-3..3), YComponent=0, ZComponent=Slider(1.042, range=0..3))  # -> Vector, Length
move_7 = Move(Geometry=divide.Points, Motion=vec.Vector)  # -> Geometry, Transform
X_4 = UnitX(Factor=1)
Z_8 = UnitZ(Factor=1)
project_4 = ProjectPoint(Point=move_7.Geometry, Direction=X_4, Geometry=extr)  # -> Point, Index
move_8 = Move(Geometry=project_4.Point, Motion=Z_8)  # -> Geometry, Transform
intcrv_5 = Interpolate(Vertices=[divide.Points, move_7.Geometry, move_8.Geometry], Degree=3, Periodic=False, KnotStyle=1)  # -> Curve, Length, Domain

# ----
tag = TextTag3D(Location=area_6.Centroid, Text=concat_6, Size=0.4, Colour=rgb, Justification=5)
tag_2 = TextTag3D(Location=area_2.Centroid, Text=concat, Size=0.4, Colour=rgb, Justification=5)
tag_3 = TextTag3D(Location=area_3.Centroid, Text=concat_2, Size=0.4, Colour=rgb, Justification=5)
tag_4 = TextTag3D(Location=area_4.Centroid, Text=concat_3, Size=0.4, Colour=rgb, Justification=5)
tag_5 = TextTag3D(Location=area_7.Centroid, Text=concat_7, Size=0.4, Colour=rgb, Justification=5)
tag_6 = TextTag3D(Location=area_5.Centroid, Text=concat_5, Size=0.4, Colour=rgb, Justification=5)
tag_7 = TextTag3D(Location=area.Centroid, Text=concat_4, Size=0.4, Colour=rgb, Justification=5)
ma = MassAddition(Input=[area_2.Area, area_3.Area, area_4.Area, area_7.Area, area_6.Area, area_5.Area, area.Area])  # -> Result, PartialResults
round_8 = Round(Number=ma.Result)  # -> Nearest, Floor, Ceiling
pt_22 = ConstructPoint(XCoordinate=2, YCoordinate=0, ZCoordinate=0)
concat_8 = Concatenate(FragmentA=round_8.Nearest, FragmentB="m² - área total")
tag_8 = TextTag3D(Location=pt_22, Text=concat_8, Size=0.5, Justification=7)
