# Grasshopper definition volume_shed_centralStructure.ghx (Grasshopper 0.9.76)

# ---- group: Parede central
number_slider = Slider(-7, range=-20..0)
md_slider = MDSlider(
    slider_value=Point(0.1800725954, 0.1030852565, 0.5),
    SliderMode=0,
    x_domain=Domain(0, 10),
    y_domain=Domain(0, 40),
    z_domain=Domain(0, 1))
md_slider_2 = MDSlider(
    slider_value=Point(0.506018092, 0.2143459885, 0.5),
    SliderMode=0,
    x_domain=Domain(-10, 10),
    y_domain=Domain(0, 40),
    z_domain=Domain(0, 1))
md_slider_3 = MDSlider(
    slider_value=Point(0.5670363205, 0.1466505438, 0.5),
    SliderMode=0,
    x_domain=Domain(0, 10),
    y_domain=Domain(0, 40),
    z_domain=Domain(0, 1))
parede_central_reta_ou_curva = BooleanToggle(True)
altura = Slider(4, range=2..8)

# ---- group: Setor de instalações
ponto_de_origem = Slider(0, range=0..30)
posição_do_bloco_da_direita_instalações = Slider(32, range=0..50)
number_slider_2 = Slider(-24, range=-50..0)

# ---- group: Setor de instalações / Primeiro bloco
number_slider_3 = Slider(5, range=0..20)
number_slider_4 = Slider(3, range=0..20)

# ---- group: Setor de instalações / Segundo bloco
number_slider_5 = Slider(5, range=0..20)
number_slider_6 = Slider(3, range=0..20)

# ---- group: Setor de instalações / Terceiro bloco
number_slider_7 = Slider(5, range=0..20)
number_slider_8 = Slider(3, range=0..20)

# ---- group: Setor de instalações / Quarto bloco
number_slider_9 = Slider(-8, range=-20..20)
number_slider_10 = Slider(4, range=0..20)

# ---- group: Parede central
number_slider_11 = Slider(-7, range=-20..0)
md_slider_4 = MDSlider(
    slider_value=Point(0.1800725954, 0.1030852565, 0.5),
    SliderMode=0,
    x_domain=Domain(0, 10),
    y_domain=Domain(0, 40),
    z_domain=Domain(0, 1))
md_slider_5 = MDSlider(
    slider_value=Point(0.506018092, 0.2143459885, 0.5),
    SliderMode=0,
    x_domain=Domain(-10, 10),
    y_domain=Domain(0, 40),
    z_domain=Domain(0, 1))
md_slider_6 = MDSlider(
    slider_value=Point(0.5670363205, 0.1466505438, 0.5),
    SliderMode=0,
    x_domain=Domain(0, 10),
    y_domain=Domain(0, 40),
    z_domain=Domain(0, 1))
parede_central_reta_ou_curva_2 = BooleanToggle(True)
altura_2 = Slider(4.069, range=2..8)

# ---- group: Execução
secundária = MDSlider(
    slider_value=Point(0.8994790173, 0.2880299483, 0.5),
    SliderMode=0,
    x_domain=Domain(-50, -5),
    y_domain=Domain(0, 50),
    z_domain=Domain(0, 1))
principal = MDSlider(
    slider_value=Point(0.9290073615, 0, 0.5),
    SliderMode=0,
    x_domain=Domain(-50, -10),
    y_domain=Domain(0, 50),
    z_domain=Domain(0, 1))
rotação = ControlKnob(Decimals=2, Limit=True, Maximum=1, Minimum=0, Range=1, Value=0.05)

# ----
profundidade_do_hall = Slider(24.041, range=3..50)
pt = ConstructPoint(XCoordinate=ponto_de_origem, YCoordinate=0, ZCoordinate=0)

md_slider_7 = MDSlider(
    slider_value=Point(0, 0.1040446529, 0.5),
    SliderMode=0,
    x_domain=Domain(0, 10),
    y_domain=Domain(0, 40),
    z_domain=Domain(0, 1))
md_slider_8 = MDSlider(
    slider_value=Point(0, 0.03770643164, 0.5),
    SliderMode=0,
    x_domain=Domain(0, 10),
    y_domain=Domain(0, 40),
    z_domain=Domain(0, 1))
md_slider_9 = MDSlider(
    slider_value=Point(0, 0.07629417478, 0.5),
    SliderMode=0,
    x_domain=Domain(0, 10),
    y_domain=Domain(0, 40),
    z_domain=Domain(0, 1))
md_slider_10 = MDSlider(
    slider_value=Point(0, 0.2051355749, 0.5),
    SliderMode=0,
    x_domain=Domain(0, 10),
    y_domain=Domain(0, 40),
    z_domain=Domain(0, 1))
md_slider_11 = MDSlider(
    slider_value=Point(0, 0.09096931516, 0.5),
    SliderMode=0,
    x_domain=Domain(0, 10),
    y_domain=Domain(0, 40),
    z_domain=Domain(0, 1))
md_slider_12 = MDSlider(
    slider_value=Point(0.201135804, 0.03449272214, 0.5),
    SliderMode=0,
    x_domain=Domain(0, 10),
    y_domain=Domain(0, 40),
    z_domain=Domain(0, 1))
parede_central_reta_ou_curva_3 = BooleanToggle(True)
altura_3 = Slider(4, range=2..8)
X = UnitX(Factor=Slider(0, range=-20..0))
move = Move(Geometry=pt, Motion=X)  # -> Geometry, Transform
move_2 = Move(Geometry=move.Geometry, Motion=md_slider_7)  # -> Geometry, Transform
move_3 = Move(Geometry=move_2.Geometry, Motion=md_slider_10)  # -> Geometry, Transform
move_4 = Move(Geometry=move_2.Geometry, Motion=md_slider_8)  # -> Geometry, Transform
move_5 = Move(Geometry=move_3.Geometry, Motion=md_slider_11)  # -> Geometry, Transform
move_6 = Move(Geometry=move_5.Geometry, Motion=md_slider_12)  # -> Geometry, Transform
move_7 = Move(Geometry=move_4.Geometry, Motion=md_slider_9)  # -> Geometry, Transform
pdecon = Deconstruct(Point=move_7.Geometry)  # -> XComponent, YComponent, ZComponent
p_n_c = PickNChoose(Pattern=parede_central_reta_ou_curva_3, Stream0=1, Stream1=3)
Z = UnitZ(Factor=altura_3)
intcrv = Interpolate(
    Vertices=[move.Geometry, move_2.Geometry, move_4.Geometry, move_7.Geometry, move_3.Geometry, move_5.Geometry, move_6.Geometry],
    Degree=p_n_c,
    Periodic=False,
    KnotStyle=1)  # -> Curve, Length, Domain
extr = Extrude(Base=intcrv.Curve, Direction=Z)

md_slider_13 = MDSlider(
    slider_value=Point(0, 0.1040446529, 0.5),
    SliderMode=0,
    x_domain=Domain(0, 10),
    y_domain=Domain(0, 40),
    z_domain=Domain(0, 1))
md_slider_14 = MDSlider(
    slider_value=Point(0, 0.03770643164, 0.5),
    SliderMode=0,
    x_domain=Domain(0, 10),
    y_domain=Domain(0, 40),
    z_domain=Domain(0, 1))
md_slider_15 = MDSlider(
    slider_value=Point(0, 0.07629417478, 0.5),
    SliderMode=0,
    x_domain=Domain(0, 10),
    y_domain=Domain(0, 40),
    z_domain=Domain(0, 1))
md_slider_16 = MDSlider(
    slider_value=Point(0, 0.2051355749, 0.5),
    SliderMode=0,
    x_domain=Domain(0, 10),
    y_domain=Domain(0, 40),
    z_domain=Domain(0, 1))
md_slider_17 = MDSlider(
    slider_value=Point(0, 0.09096931516, 0.5),
    SliderMode=0,
    x_domain=Domain(0, 10),
    y_domain=Domain(0, 40),
    z_domain=Domain(0, 1))
md_slider_18 = MDSlider(
    slider_value=Point(0.201135804, 0.03449272214, 0.5),
    SliderMode=0,
    x_domain=Domain(0, 10),
    y_domain=Domain(0, 40),
    z_domain=Domain(0, 1))
parede_central_reta_ou_curva_4 = BooleanToggle(True)
altura_4 = Slider(4, range=2..8)
X_2 = UnitX(Factor=Slider(0, range=-20..0))
move_8 = Move(Geometry=pt, Motion=X_2)  # -> Geometry, Transform
move_9 = Move(Geometry=move_8.Geometry, Motion=md_slider_13)  # -> Geometry, Transform
move_10 = Move(Geometry=move_9.Geometry, Motion=md_slider_16)  # -> Geometry, Transform
move_11 = Move(Geometry=move_10.Geometry, Motion=md_slider_17)  # -> Geometry, Transform
move_12 = Move(Geometry=move_11.Geometry, Motion=md_slider_18)  # -> Geometry, Transform
move_13 = Move(Geometry=move_9.Geometry, Motion=md_slider_14)  # -> Geometry, Transform
move_14 = Move(Geometry=move_13.Geometry, Motion=md_slider_15)  # -> Geometry, Transform
pdecon_2 = Deconstruct(Point=move_14.Geometry)  # -> XComponent, YComponent, ZComponent
intcrv_2 = Interpolate(
    Vertices=[move_8.Geometry, move_9.Geometry, move_13.Geometry, move_14.Geometry, move_10.Geometry, move_11.Geometry, move_12.Geometry],
    Degree=3,
    Periodic=False,
    KnotStyle=1)  # -> Curve, Length, Domain
Z_2 = UnitZ(Factor=altura_4)

addition = Addition(A=posição_do_bloco_da_direita_instalações, B=number_slider_2)

unit_z = UnitZ(Factor=Slider(4.6, range=0..10))
move_15 = Move(Geometry=move_11.Geometry, Motion=unit_z)  # -> Geometry, Transform

unit_z_2 = UnitZ(Factor=1)

# ---- group: Parede divisória central
X_3 = UnitX(Factor=number_slider)
move_16 = Move(Geometry=pt, Motion=X_3)  # -> Geometry, Transform
move_17 = Move(Geometry=move_16.Geometry, Motion=md_slider)  # -> Geometry, Transform
move_18 = Move(Geometry=move_17.Geometry, Motion=md_slider_2)  # -> Geometry, Transform
move_19 = Move(Geometry=move_18.Geometry, Motion=md_slider_3)  # -> Geometry, Transform
pdecon_3 = Deconstruct(Point=move_19.Geometry)  # -> XComponent, YComponent, ZComponent
p_n_c_2 = PickNChoose(Pattern=parede_central_reta_ou_curva, Stream0=1, Stream1=3)
Z_3 = UnitZ(Factor=altura)
intcrv_3 = Interpolate(
    Vertices=[move_16.Geometry, move_17.Geometry, move_18.Geometry, move_19.Geometry],
    Degree=p_n_c_2,
    Periodic=False,
    KnotStyle=1)  # -> Curve, Length, Domain

# ----
unit_z_3 = UnitZ(Factor=Slider(4.7, range=0..10))
unit_z_4 = UnitZ(Factor=Slider(4.3, range=0..10))
move_20 = Move(Geometry=move_12.Geometry, Motion=unit_z_3)  # -> Geometry, Transform
move_21 = Move(Geometry=move_19.Geometry, Motion=unit_z_4)  # -> Geometry, Transform

unit_z_5 = UnitZ(Factor=Slider(4, range=0..10))
unit_z_6 = UnitZ(Factor=Slider(5.2, range=0..10))
move_22 = Move(Geometry=move_10.Geometry, Motion=unit_z_5)  # -> Geometry, Transform
move_23 = Move(Geometry=move_18.Geometry, Motion=unit_z_6)  # -> Geometry, Transform

unit_z_7 = UnitZ(Factor=Slider(5.5, range=0..10))
unit_z_8 = UnitZ(Factor=Slider(4.3, range=0..10))
move_24 = Move(Geometry=move_9.Geometry, Motion=unit_z_7)  # -> Geometry, Transform
move_25 = Move(Geometry=move_17.Geometry, Motion=unit_z_8)  # -> Geometry, Transform

unit_z_9 = UnitZ(Factor=Slider(4.2, range=0..10))
unit_z_10 = UnitZ(Factor=Slider(5.7, range=0..10))
move_26 = Move(Geometry=pt, Motion=unit_z_9)  # -> Geometry, Transform
move_27 = Move(Geometry=move_16.Geometry, Motion=unit_z_10)  # -> Geometry, Transform

# ---- group: Instalações (em planta)
addition_2 = Addition(A=ponto_de_origem, B=number_slider_3)
addition_3 = Addition(A=addition, B=number_slider_4)
addition_4 = Addition(A=ponto_de_origem, B=number_slider_5)
addition_5 = Addition(A=addition_3, B=number_slider_6)
addition_6 = Addition(A=ponto_de_origem, B=number_slider_7)
addition_7 = Addition(A=addition_5, B=number_slider_8)
addition_8 = Addition(A=ponto_de_origem, B=number_slider_9)
addition_9 = Addition(A=addition_7, B=number_slider_10)
pt_2 = ConstructPoint(XCoordinate=ponto_de_origem, YCoordinate=addition, ZCoordinate=0)
pt_3 = ConstructPoint(XCoordinate=addition_2, YCoordinate=addition_3, ZCoordinate=0)
pt_4 = ConstructPoint(XCoordinate=ponto_de_origem, YCoordinate=addition_3, ZCoordinate=0)
pt_5 = ConstructPoint(XCoordinate=addition_4, YCoordinate=addition_5, ZCoordinate=0)
pt_6 = ConstructPoint(XCoordinate=ponto_de_origem, YCoordinate=addition_5, ZCoordinate=0)
pt_7 = ConstructPoint(XCoordinate=addition_6, YCoordinate=addition_7, ZCoordinate=0)
pt_8 = ConstructPoint(XCoordinate=addition_8, YCoordinate=addition_9, ZCoordinate=0)
rec_2pt = Rectangle2Pt(Plane=PlaneXY(0, 0, 0), PointA=pt_2, PointB=pt_3, Radius=0)  # -> Rectangle, Length
rec_2pt_2 = Rectangle2Pt(Plane=PlaneXY(0, 0, 0), PointA=pt_4, PointB=pt_5, Radius=0)  # -> Rectangle, Length
rec_2pt_3 = Rectangle2Pt(Plane=PlaneXY(0, 0, 0), PointA=pt_6, PointB=pt_7, Radius=0)  # -> Rectangle, Length
rec_2pt_4 = Rectangle2Pt(Plane=PlaneXY(0, 0, 0), PointA=pt_7, PointB=pt_8, Radius=0)  # -> Rectangle, Length

# ---- group: Parede divisória central
X_4 = UnitX(Factor=number_slider_11)
move_28 = Move(Geometry=pt, Motion=X_4)  # -> Geometry, Transform
move_29 = Move(Geometry=move_28.Geometry, Motion=md_slider_4)  # -> Geometry, Transform
move_30 = Move(Geometry=move_29.Geometry, Motion=md_slider_5)  # -> Geometry, Transform
move_31 = Move(Geometry=move_30.Geometry, Motion=md_slider_6)  # -> Geometry, Transform
pdecon_4 = Deconstruct(Point=move_31.Geometry)  # -> XComponent, YComponent, ZComponent
p_n_c_3 = PickNChoose(Pattern=parede_central_reta_ou_curva_2, Stream0=1, Stream1=3)
Z_4 = UnitZ(Factor=altura_2)
intcrv_4 = Interpolate(
    Vertices=[move_28.Geometry, move_29.Geometry, move_30.Geometry, move_31.Geometry],
    Degree=p_n_c_3,
    Periodic=False,
    KnotStyle=1)  # -> Curve, Length, Domain
extr_2 = Extrude(Base=intcrv_4.Curve, Direction=Z_4)

# ----
move_32 = Move(Geometry=move_18.Geometry, Motion=md_slider_2)  # -> Geometry, Transform

# ---- group: Hall
min = Minimum(A=profundidade_do_hall, B=pdecon_4.YComponent)
pt_9 = ConstructPoint(XCoordinate=-50, YCoordinate=min, ZCoordinate=0)
rec_2pt_5 = Rectangle2Pt(Plane=PlaneXY(0, 0, 0), PointA=Point(0, 0, 0), PointB=pt_9, Radius=0)  # -> Rectangle, Length
srfsplit = SurfaceSplit(Surface=rec_2pt_5.Rectangle, Curves=intcrv_4.Curve)
rev = ReverseList(List=srfsplit)
item = CherryPicker(rev, ListIndex=0, TreePath_path="{0;0}")

# ---- group: Execução
rec_2pt_6 = Rectangle2Pt(Plane=PlaneXY(0, 0, 0), PointA=Point(0, 0, 0), PointB=secundária, Radius=0)  # -> Rectangle, Length
rec_2pt_7 = Rectangle2Pt(Plane=PlaneXY(0, 0, 0), PointA=secundária, PointB=principal, Radius=0)  # -> Rectangle, Length
rotate = Rotate(Geometry=rec_2pt_6.Rectangle, Angle=expr("-2*pi*x", rotação), Plane=PlaneXY(0, 0, 0))  # -> Geometry, Transform
rotate_2 = Rotate(Geometry=rec_2pt_7.Rectangle, Angle=expr("-2*pi*x", rotação), Plane=PlaneXY(0, 0, 0))  # -> Geometry, Transform
srfsplit_2 = SurfaceSplit(Surface=rotate.Geometry, Curves=intcrv_4.Curve)
item_2 = CherryPicker(srfsplit_2, ListIndex=0)

# ----
loft = Loft(
    Curves=[intcrv_2.Curve, intcrv_3.Curve],
    Options={Adjust=False, Closed=False, LoftEnds=0, LoftSimp=0, LoftType=0, Rebuild=10, Refit=0.01})
number_slider_12 = Slider(4, range=0..10)

# ---- group: Linhas que geram a cobertura
number_slider_13 = Slider(3.462, range=2..5)
number_slider_14 = Slider(3.386, range=2..5)
number_slider_15 = Slider(2.86, range=2..5)
number_slider_16 = Slider(3.728, range=2..5)
number_slider_17 = Slider(3.57, range=1..5)
number_slider_18 = Slider(2.805, range=2..5)

# ----
divide_curve = DivideCurve(Curve=intcrv_2.Curve, Count=number_slider_12, Kinks=False)  # -> Points, Tangents, Parameters

number_slider_19 = Slider(0.018, range=0..0.1)
knob = ControlKnob(Decimals=2, Limit=True, Maximum=1, Minimum=0, Range=1, Value=0.09)

rgb = ColourRGB(Alpha=255, Red=0, Green=0, Blue=255)

# ---- group: Cobertura do hall
pt_10 = ConstructPoint(XCoordinate=0, YCoordinate=Slider(8.598, range=-10..70), ZCoordinate=Slider(3.672, range=0..10))
pt_11 = ConstructPoint(XCoordinate=0, YCoordinate=Slider(14.431, range=-10..70), ZCoordinate=Slider(3.164, range=0..10))
pt_12 = ConstructPoint(XCoordinate=0, YCoordinate=Slider(25.443, range=-10..70), ZCoordinate=Slider(2.694, range=0..10))
pt_13 = ConstructPoint(XCoordinate=0, YCoordinate=Slider(23.421, range=-10..70), ZCoordinate=Slider(6.879, range=0..10))
p_n_c_4 = PickNChoose(Pattern=Toggle(True), Stream0=1, Stream1=3)
X_5 = UnitX(Factor=expr("x-2", number_slider_11))
intcrv_5 = Interpolate(Vertices=[pt_10, pt_11, pt_12, pt_13], Degree=p_n_c_4, Periodic=False, KnotStyle=1)  # -> Curve, Length, Domain
extr_3 = Extrude(Base=intcrv_5.Curve, Direction=X_5)
range = Range(Domain=Slider(-5.578, range=-20..1), Steps=Slider(60, range=0..60))
rotate_3 = Rotate(Geometry=extr_3, Angle=expr("-2*Pi*x", knob), Plane=PlaneXY(0, 0, 0))  # -> Geometry, Transform
rotate_4 = Rotate(Geometry=intcrv_5.Curve, Angle=expr("-2*Pi*x", knob), Plane=PlaneXY(0, 0, 0))  # -> Geometry, Transform
X_6 = UnitX(Factor=range)
project = Project(Curve=item, Brep=rotate_3.Geometry, Direction=Vector(0, 0, 1))
patch = Patch(Curves=project, Spans=20, Flexibility=1, Trim=True)
move_33 = Move(Geometry=rotate_4.Geometry, Motion=X_6)  # -> Geometry, Transform
xz = XZPlane(Origin=Point(0, 0, 0))
dom = ConstructDomain(DomainStart=number_slider_19, DomainEnd=expr("-x", number_slider_19))
dom_2 = ConstructDomain(DomainStart=0, DomainEnd=expr("-x", Slider(0.157, range=0..0.4)))
project_2 = Project(Curve=move_33.Geometry, Brep=patch, Direction=Vector(0, 0, 1))
rectangle = Rectangle(Plane=xz, XSize=dom, YSize=dom_2, Radius=0)  # -> Rectangle, Length
end = EndPoints(Curve=project_2)  # -> Start, End
pt_14 = ConstructPoint(XCoordinate=0, YCoordinate=0, ZCoordinate=0)
extrcrv = ExtrudeAlong(Base=rectangle.Rectangle, Curve=project_2)
vec2pt = Vector2Pt(PointA=pt_14, PointB=end.Start, Unitize=False)  # -> Vector, Length
move_34 = Move(Geometry=extrcrv, Motion=vec2pt.Vector)  # -> Geometry, Transform

# ---- group: Nomes e áreas
area = Area(Geometry=rec_2pt_4.Rectangle)  # -> Area, Centroid
area_2 = Area(Geometry=rec_2pt_3.Rectangle)  # -> Area, Centroid
area_3 = Area(Geometry=rec_2pt_2.Rectangle)  # -> Area, Centroid
area_4 = Area(Geometry=rec_2pt.Rectangle)  # -> Area, Centroid
area_5 = Area(Geometry=item_2)  # -> Area, Centroid
area_6 = Area(Geometry=rotate_2.Geometry)  # -> Area, Centroid
area_7 = Area(Geometry=item)  # -> Area, Centroid
round = Round(Number=area.Area)  # -> Nearest, Floor, Ceiling
round_2 = Round(Number=area_2.Area)  # -> Nearest, Floor, Ceiling
round_3 = Round(Number=area_3.Area)  # -> Nearest, Floor, Ceiling
round_4 = Round(Number=area_4.Area)  # -> Nearest, Floor, Ceiling
round_5 = Round(Number=area_5.Area)  # -> Nearest, Floor, Ceiling
round_6 = Round(Number=area_6.Area)  # -> Nearest, Floor, Ceiling
round_7 = Round(Number=area_7.Area)  # -> Nearest, Floor, Ceiling
concat = Concatenate(FragmentA=round.Nearest, FragmentB=" m2 (marcenaria)")
concat_2 = Concatenate(FragmentA=round_2.Nearest, FragmentB=" m2 (cozinha)")
concat_3 = Concatenate(FragmentA=round_3.Nearest, FragmentB=" m2 (i.s.m.)")
concat_4 = Concatenate(FragmentA=round_4.Nearest, FragmentB=" m2 (i.s.f.)")
concat_5 = Concatenate(FragmentA=round_5.Nearest, FragmentB=" m2 (exec. secundária)")
concat_6 = Concatenate(FragmentA=round_6.Nearest, FragmentB=" m2 (exec. principal)")
concat_7 = Concatenate(FragmentA=round_7.Nearest, FragmentB=" m2 (hall)")

# ---- group: Cobertura da parte de execução
sunion = SolidUnion(Breps=[item_2, rotate_2.Geometry])
disc = Discontinuity(Curve=sunion, Level=1)  # -> graft(Points), Parameters
item_3 = CherryPicker(disc.Points, ListIndex=0, TreePath_path="{0;0;0}")
item_4 = CherryPicker(disc.Points, ListIndex=0, TreePath_path="{0;0;3}")
ln = Line(StartPoint=item_3, EndPoint=item_4)
divide = DivideCurve(Curve=ln, Count=Slider(28, range=0..50), Kinks=False)  # -> graft(Points), Tangents, Parameters
vec = VectorXYZ(XComponent=Slider(-1.022, range=-3..3), YComponent=0, ZComponent=Slider(1.042, range=0..3))  # -> Vector, Length
move_35 = Move(Geometry=divide.Points, Motion=vec.Vector)  # -> Geometry, Transform
X_7 = UnitX(Factor=1)
Z_5 = UnitZ(Factor=1)
project_3 = ProjectPoint(Point=move_35.Geometry, Direction=X_7, Geometry=extr_2)  # -> Point, Index
move_36 = Move(Geometry=project_3.Point, Motion=Z_5)  # -> Geometry, Transform
intcrv_6 = Interpolate(Vertices=[divide.Points, move_35.Geometry, move_36.Geometry], Degree=3, Periodic=False, KnotStyle=1)  # -> Curve, Length, Domain

# ---- group: Viga
interpolate = Interpolate(Vertices=[move_27.Geometry, move_25.Geometry, move_23.Geometry, move_21.Geometry], Degree=3, Periodic=False, KnotStyle=1)  # -> Curve, Length, Domain
unit_z_11 = UnitZ(Factor=Slider(-0.2, range=-1..-0.2))
unit_z_12 = UnitZ(Factor=Slider(0.1, range=0..0.1))
move_37 = Move(Geometry=interpolate.Curve, Motion=unit_z_12)  # -> Geometry, Transform
move_38 = Move(Geometry=move_37.Geometry, Motion=unit_z_11)  # -> Geometry, Transform
loft_2 = Loft(
    Curves=[move_37.Geometry, move_38.Geometry],
    Options={Adjust=False, Closed=False, LoftEnds=0, LoftSimp=0, LoftType=0, Rebuild=10, Refit=0.01})
unit_x = UnitX(Factor=Slider(0.2, range=0..1))
extrude = Extrude(Base=loft_2, Direction=unit_x)

# ----
loft_3 = Loft(
    Curves=[intcrv_4.Curve, interpolate.Curve],
    Options={Adjust=False, Closed=False, LoftEnds=0, LoftSimp=0, LoftType=0, Rebuild=10, Refit=0.01})
divide_curve_2 = DivideCurve(Curve=interpolate.Curve, Count=number_slider_12, Kinks=False)  # -> Points, Tangents, Parameters
divide_curve_3 = DivideCurve(Curve=[intcrv_3.Curve, interpolate.Curve], Count=number_slider_12, Kinks=False)  # -> Points, Tangents, Parameters
vector_2pt = Vector2Pt(PointA=divide_curve_3.Points, PointB=divide_curve_3.Points, Unitize=False)  # -> Vector, Length
line = Line(StartPoint=divide_curve_3.Points, EndPoint=divide_curve_2.Points)

# ---- group: Pilares
construct_point = ConstructPoint(XCoordinate=0, YCoordinate=0, ZCoordinate=0)
number_slider_20 = Slider(0.2, range=0..1)
vector_2pt_2 = Vector2Pt(PointA=construct_point, PointB=divide_curve_3.Points, Unitize=False)  # -> Vector, Length
rectangle_2 = Rectangle(Plane=PlaneXY(0, 0, 0), XSize=number_slider_20, YSize=number_slider_20, Radius=0)  # -> Rectangle, Length
extrude_along = ExtrudeAlong(Base=rectangle_2.Rectangle, Curve=line)
move_39 = Move(Geometry=extrude_along, Motion=vector_2pt_2.Vector)  # -> Geometry, Transform
cap_holes = CapHoles(Brep=move_39.Geometry)

# ---- group: Viga
interpolate_2 = Interpolate(
    Vertices=[move_26.Geometry, move_24.Geometry, move_22.Geometry, move_15.Geometry, move_20.Geometry],
    Degree=3,
    Periodic=False,
    KnotStyle=1)  # -> Curve, Length, Domain
unit_z_13 = UnitZ(Factor=Slider(-0.2, range=-1..-0.2))
unit_z_14 = UnitZ(Factor=Slider(0.1, range=0..0.1))
move_40 = Move(Geometry=interpolate_2.Curve, Motion=unit_z_14)  # -> Geometry, Transform
move_41 = Move(Geometry=move_40.Geometry, Motion=unit_z_13)  # -> Geometry, Transform
loft_4 = Loft(
    Curves=[move_40.Geometry, move_41.Geometry],
    Options={Adjust=False, Closed=False, LoftEnds=0, LoftSimp=0, LoftType=0, Rebuild=10, Refit=0.01})
unit_x_2 = UnitX(Factor=Slider(-0.2, range=-1..-0.2))
extrude_2 = Extrude(Base=loft_4, Direction=unit_x_2)

# ----
loft_5 = Loft(
    Curves=[intcrv_2.Curve, interpolate_2.Curve],
    Options={Adjust=False, Closed=False, LoftEnds=0, LoftSimp=0, LoftType=0, Rebuild=10, Refit=0.01})
divide_curve_4 = DivideCurve(Curve=interpolate_2.Curve, Count=number_slider_12, Kinks=False)  # -> Points, Tangents, Parameters
line_2 = Line(StartPoint=divide_curve.Points, EndPoint=divide_curve_4.Points)

# ---- group: Vigas da cobertura
number_slider_21 = Slider(50, range=0..100)
divide_curve_5 = DivideCurve(Curve=interpolate.Curve, Count=number_slider_21, Kinks=False)  # -> Points, Tangents, Parameters
divide_curve_6 = DivideCurve(Curve=interpolate_2.Curve, Count=number_slider_21, Kinks=False)  # -> Points, Tangents, Parameters
unit_z_15 = UnitZ(Factor=Slider(0.1, range=0..0.1))
line_3 = Line(StartPoint=divide_curve_5.Points, EndPoint=divide_curve_6.Points)
vector_2pt_3 = Vector2Pt(PointA=divide_curve_5.Points, PointB=divide_curve_5.Points, Unitize=False)  # -> Vector, Length
construct_point_2 = ConstructPoint(XCoordinate=0, YCoordinate=0, ZCoordinate=0)
number_slider_22 = Slider(0.25, range=0..1)
unit_z_16 = UnitZ(Factor=number_slider_22)
move_42 = Move(Motion=unit_z_16)  # -> Geometry, Transform
extrude_3 = Extrude(Base=move_42.Geometry, Direction=unit_z_15)
yz_plane = YZPlane(Origin=Point(0, 0, 0))
vector_2pt_4 = Vector2Pt(PointA=construct_point_2, PointB=divide_curve_5.Points, Unitize=False)  # -> Vector, Length
construct_domain = ConstructDomain(DomainStart=expr("-x", 0), DomainEnd=Slider(0.1, range=0..1))
rectangle_3 = Rectangle(Plane=yz_plane, XSize=construct_domain, YSize=number_slider_22, Radius=0)  # -> Rectangle, Length
extrude_along_2 = ExtrudeAlong(Base=rectangle_3.Rectangle, Curve=line_3)
move_43 = Move(Geometry=extrude_along_2, Motion=vector_2pt_4.Vector)  # -> Geometry, Transform
cap_holes_2 = CapHoles(Brep=move_43.Geometry)

# ---- group: Pilares
construct_point_3 = ConstructPoint(XCoordinate=0, YCoordinate=0, ZCoordinate=0)
vector_2pt_5 = Vector2Pt(PointA=construct_point_3, PointB=divide_curve.Points, Unitize=False)  # -> Vector, Length
rectangle_4 = Rectangle(Plane=PlaneXY(0, 0, 0), XSize=Slider(-0.2, range=-1..-0.2), YSize=Slider(0.2, range=0..1), Radius=0)  # -> Rectangle, Length
extrude_along_3 = ExtrudeAlong(Base=rectangle_4.Rectangle, Curve=line_2)
move_44 = Move(Geometry=extrude_along_3, Motion=vector_2pt_5.Vector)  # -> Geometry, Transform
cap_holes_3 = CapHoles(Brep=move_44.Geometry)

# ----
tag = TextTag3D(Location=area.Centroid, Text=concat, Size=0.4, Colour=rgb, Justification=5)
tag_2 = TextTag3D(Location=area_2.Centroid, Text=concat_2, Size=0.4, Colour=rgb, Justification=5)
tag_3 = TextTag3D(Location=area_3.Centroid, Text=concat_3, Size=0.4, Colour=rgb, Justification=5)
tag_4 = TextTag3D(Location=area_4.Centroid, Text=concat_4, Size=0.4, Colour=rgb, Justification=5)
tag_5 = TextTag3D(Location=area_5.Centroid, Text=concat_5, Size=0.4, Colour=rgb, Justification=5)
tag_6 = TextTag3D(Location=area_6.Centroid, Text=concat_6, Size=0.4, Colour=rgb, Justification=5)
tag_7 = TextTag3D(Location=area_7.Centroid, Text=concat_7, Size=0.4, Colour=rgb, Justification=5)
ma = MassAddition(Input=[area.Area, area_2.Area, area_3.Area, area_4.Area, area_5.Area, area_6.Area, area_7.Area])  # -> Result, PartialResults
round_8 = Round(Number=ma.Result)  # -> Nearest, Floor, Ceiling
pt_15 = ConstructPoint(XCoordinate=2, YCoordinate=0, ZCoordinate=0)
concat_8 = Concatenate(FragmentA=round_8.Nearest, FragmentB="m² - área total")
tag_8 = TextTag3D(Location=pt_15, Text=concat_8, Size=0.5, Justification=7)
md_slider_19 = MDSlider(
    slider_value=Point(0.4833775962, 0.2199327422, 0.5),
    SliderMode=0,
    x_domain=Domain(-30, 30),
    y_domain=Domain(-30, 30),
    z_domain=Domain(0, 1))
Y = UnitY(Factor=Slider(10.912, range=4..20))
md_slider_20 = MDSlider(
    slider_value=Point(0.6373201696, 0.4798792397, 0.5),
    SliderMode=0,
    x_domain=Domain(-50, 50),
    y_domain=Domain(-50, 50),
    z_domain=Domain(0, 1))
md_slider_21 = MDSlider(
    slider_value=Point(0.4695121951, 0.4954923304, 0.5),
    SliderMode=0,
    x_domain=Domain(-50, 50),
    y_domain=Domain(-50, 50),
    z_domain=Domain(0, 1))
loft_6 = Loft(
    Curves=[interpolate_2.Curve, interpolate.Curve],
    Options={Adjust=False, Closed=False, LoftEnds=0, LoftSimp=0, LoftType=0, Rebuild=10, Refit=0.01})
cap_holes_4 = CapHoles(Brep=[extrude, extrude_2])
brep_join = BrepJoin(Breps=[cap_holes, cap_holes_3])  # -> Breps, Closed
unit_z_17 = UnitZ(Factor=Slider(0.41, range=0..1))
number_slider_23 = Slider(0.1, range=0..0.1)
extrude_4 = Extrude(Base=loft_6, Direction=unit_z_17)
solid_difference = SolidDifference(BrepsA=cap_holes_2, BrepsB=cap_holes_4)
solid_difference_2 = SolidDifference(BrepsA=cap_holes_4, BrepsB=brep_join.Breps)
md_slider_22 = MDSlider(
    slider_value=Point(0.2804937595, 0.6141476515, 0.5),
    SliderMode=0,
    x_domain=Domain(-30, 30),
    y_domain=Domain(-30, 30),
    z_domain=Domain(0, 1))
Z_6 = UnitZ(Factor=Slider(-5, range=-5..1))
Z_7 = UnitZ(Factor=Slider(-5, range=-5..1))
Z_8 = UnitZ(Factor=Slider(-5, range=-5..1))
Z_9 = UnitZ(Factor=Slider(-50, range=-50..1))
pt_16 = Point(md_slider_22)
move_45 = Move(Geometry=pt_16, Motion=Z_9)  # -> Geometry, Transform
rectangle_5 = Rectangle(Plane=PlaneXY(0, 0, 0), XSize=Domain(-100, 100), YSize=Domain(-100, 100), Radius=0)  # -> Rectangle, Length
rectangle_6 = Rectangle(Plane=PlaneXY(0, 0, 0), XSize=Domain(-100, 100), YSize=Domain(-100, 100), Radius=0)  # -> Rectangle, Length

# ---- group: Cobertura da área de instalações
panel = Panel([addition_4, addition_6, addition_2, addition_8])
runion = RegionUnion(Curves=[rec_2pt.Rectangle, rec_2pt_2.Rectangle, rec_2pt_3.Rectangle, rec_2pt_4.Rectangle])
sort = SortList(Keys=panel)  # -> Keys, ValuesA
rev_2 = ReverseList(List=sort.Keys)
item_5 = CherryPicker(rev_2, ListIndex=0)
Z_10 = UnitZ(Factor=number_slider_16)
Z_11 = UnitZ(Factor=number_slider_17)
Z_12 = UnitZ(Factor=number_slider_18)
Z_13 = UnitZ(Factor=number_slider_13)
Z_14 = UnitZ(Factor=number_slider_14)
Z_15 = UnitZ(Factor=number_slider_15)
subtraction = Subtraction(A=item_5, B=ponto_de_origem)
division = Division(A=subtraction, B=2)
pt_17 = ConstructPoint(XCoordinate=ponto_de_origem, YCoordinate=0, ZCoordinate=Z_13)
pt_18 = ConstructPoint(XCoordinate=item_5, YCoordinate=0, ZCoordinate=Z_15)
pt_19 = ConstructPoint(XCoordinate=ponto_de_origem, YCoordinate=posição_do_bloco_da_direita_instalações, ZCoordinate=Z_10)
pt_20 = ConstructPoint(XCoordinate=item_5, YCoordinate=posição_do_bloco_da_direita_instalações, ZCoordinate=Z_12)
addition_10 = Addition(A=ponto_de_origem, B=division)
pt_21 = ConstructPoint(XCoordinate=addition_10, YCoordinate=0, ZCoordinate=Z_14)
pt_22 = ConstructPoint(XCoordinate=addition_10, YCoordinate=posição_do_bloco_da_direita_instalações, ZCoordinate=Z_11)
intcrv_7 = Interpolate(Vertices=[pt_19, pt_22, pt_20], Degree=3, Periodic=False, KnotStyle=1)  # -> Curve, Length, Domain
intcrv_8 = Interpolate(Vertices=[pt_17, pt_21, pt_18], Degree=3, Periodic=False, KnotStyle=1)  # -> Curve, Length, Domain

# ---- group: segunda curva
intcrv_9 = Interpolate(Vertices=[pt_17, pt_21, pt_18], Degree=3, Periodic=False, KnotStyle=1)  # -> Curve, Length, Domain
move_46 = Move(Geometry=intcrv_9.Curve, Motion=Y)  # -> Geometry, Transform

# ---- group: 4
md_slider_23 = MDSlider(
    slider_value=Point(0.3883994498, 0.31446429, 0.5),
    SliderMode=0,
    x_domain=Domain(-30, 30),
    y_domain=Domain(-30, 30),
    z_domain=Domain(0, 1))
move_47 = Move(Geometry=intcrv_7.Curve, Motion=md_slider_23)  # -> Geometry, Transform
curvepoint = PointOnCurve(move_47.Geometry, parameter=1)
rotate_5 = Rotate(Geometry=move_47.Geometry, Angle=Slider(1.186, range=0..3.14), Plane=curvepoint)  # -> Geometry, Transform

# ---- group: ultima curva
md_slider_24 = MDSlider(
    slider_value=Point(0.3409468488, 0.296065912, 0.5),
    SliderMode=0,
    x_domain=Domain(-30, 30),
    y_domain=Domain(-30, 30),
    z_domain=Domain(0, 1))
move_48 = Move(Geometry=intcrv_7.Curve, Motion=md_slider_24)  # -> Geometry, Transform
curvepoint_2 = PointOnCurve(move_48.Geometry, parameter=0.514)
rotate_6 = Rotate(Geometry=move_48.Geometry, Angle=Slider(1.136, range=0..3.14), Plane=curvepoint_2)  # -> Geometry, Transform

# ---- group: 1
Y_2 = UnitY(Factor=Slider(8, range=4..20))
intcrv_10 = Interpolate(Vertices=[pt_17, pt_21, pt_18], Degree=3, Periodic=False, KnotStyle=1)  # -> Curve, Length, Domain
move_49 = Move(Geometry=intcrv_10.Curve, Motion=Y_2)  # -> Geometry, Transform

# ---- group: terceira curva
move_50 = Move(Geometry=intcrv_7.Curve, Motion=md_slider_19)  # -> Geometry, Transform
curvepoint_3 = PointOnCurve(move_50.Geometry, parameter=0.149)
rotate_7 = Rotate(Geometry=move_50.Geometry, Angle=Slider(0.617, range=0..3.14), Plane=curvepoint_3)  # -> Geometry, Transform

# ---- group: Cobertura da área de instalações (continued)
rulesrf = RuledSurface(CurveA=intcrv_8.Curve, CurveB=rotate_7.Geometry)
project_4 = Project(Curve=runion, Brep=rulesrf, Direction=Vector(0, 0, 1))

# ----
loft_7 = Loft(
    Curves=[move_49.Geometry, move_46.Geometry, rotate_7.Geometry, rotate_5.Geometry, rotate_6.Geometry],
    Options={Adjust=False, Closed=False, LoftEnds=0, LoftSimp=0, LoftType=0, Rebuild=10, Refit=0.01})
edges = BrepEdges(Brep=loft_7)  # -> graft(Naked), Interior, NonManifold
item_6 = CherryPicker(edges.Naked, ListIndex=0, TreePath_path="{0;0;0}")
item_7 = CherryPicker(edges.Naked, ListIndex=0, TreePath_path="{0;0;1}")
item_8 = CherryPicker(edges.Naked, ListIndex=0, TreePath_path="{0;0;2}")
item_9 = CherryPicker(edges.Naked, ListIndex=0, TreePath_path="{0;0;3}")
extr_4 = ExtrudePoint(Base=item_8, Point=move_45.Geometry)
extr_5 = Extrude(Base=item_6, Direction=Z_6)
extr_6 = Extrude(Base=item_7, Direction=Z_7)
extr_7 = Extrude(Base=item_9, Direction=Z_8)
split = SplitBrep(Brep=extr_6, Cutter=extr_4)
split_2 = SplitBrep(Brep=extr_7, Cutter=extr_4)
item_10 = CherryPicker(split, ListIndex=0)
item_11 = CherryPicker(split_2, ListIndex=0)
split_3 = SplitBrep(Brep=extr_4, Cutter=rectangle_6.Rectangle)
split_4 = SplitBrep(Brep=extr_5, Cutter=rectangle_5.Rectangle)
split_5 = SplitBrep(Brep=item_10, Cutter=rectangle_6.Rectangle)
split_6 = SplitBrep(Brep=item_11, Cutter=rectangle_5.Rectangle)
item_12 = CherryPicker(split_3, ListIndex=0)
item_13 = CherryPicker(split_5, ListIndex=0, TreePath_path="{0;0}")
item_14 = CherryPicker(split_4, ListIndex=0)
item_15 = CherryPicker(split_6, ListIndex=0, TreePath_path="{0;0}")
