# Grasshopper definition shed_mushroom_model.ghx (Grasshopper 0.9.76)

# ---- group: Pontos pátio central
pt = ConstructPoint(XCoordinate=Slider(44, range=0..50), YCoordinate=Slider(21.1, range=0..50), ZCoordinate=Slider(0, range=0..8))
pt_2 = ConstructPoint(XCoordinate=Slider(27.8, range=0..50), YCoordinate=Slider(10.7, range=0..50), ZCoordinate=Slider(0, range=0..8))
pt_3 = ConstructPoint(XCoordinate=Slider(33.8, range=0..50), YCoordinate=Slider(8.2, range=0..50), ZCoordinate=Slider(0, range=0..8))
pt_4 = ConstructPoint(XCoordinate=Slider(34.6, range=0..50), YCoordinate=Slider(25.1, range=0..50), ZCoordinate=Slider(0, range=0..8))
pt_5 = ConstructPoint(XCoordinate=Slider(40, range=0..50), YCoordinate=Slider(13.6, range=0..50), ZCoordinate=Slider(0, range=0..8))
intcrv = Interpolate(Vertices=[pt_3, pt_5, pt, pt_4, pt_2], Degree=3, Periodic=True, KnotStyle=1)  # -> Curve, Length, Domain
area = Area(Geometry=intcrv.Curve)  # -> Area, Centroid
panel = Panel(area.Area)

# ---- group: Pontos superiores pátio central
number_slider = Slider(5, range=0..8)
pt_6 = ConstructPoint(XCoordinate=Slider(31.1, range=0..50), YCoordinate=Slider(10.5, range=0..50), ZCoordinate=number_slider)
pt_7 = ConstructPoint(XCoordinate=Slider(38.1, range=0..50), YCoordinate=Slider(15.1, range=0..50), ZCoordinate=number_slider)
pt_8 = ConstructPoint(XCoordinate=Slider(42.5, range=0..50), YCoordinate=Slider(19.4, range=0..50), ZCoordinate=number_slider)
pt_9 = ConstructPoint(XCoordinate=Slider(26.4, range=0..50), YCoordinate=Slider(17.5, range=0..50), ZCoordinate=number_slider)
pt_10 = ConstructPoint(XCoordinate=Slider(30.8, range=0..50), YCoordinate=Slider(22.5, range=0..50), ZCoordinate=number_slider)
intcrv_2 = Interpolate(Vertices=[pt_7, pt_8, pt_10, pt_9, pt_6], Degree=3, Periodic=True, KnotStyle=1)  # -> Curve, Length, Domain

# ---- group: Pontos exteriores
pt_11 = ConstructPoint(XCoordinate=Slider(29.8, range=0..50), YCoordinate=Slider(2, range=0..50), ZCoordinate=Slider(5.2, range=0..8))
pt_12 = ConstructPoint(XCoordinate=Slider(50, range=0..50), YCoordinate=Slider(0, range=0..50), ZCoordinate=Slider(0, range=0..8))
pt_13 = ConstructPoint(XCoordinate=Slider(45.7, range=0..50), YCoordinate=Slider(31.9, range=0..50), ZCoordinate=Slider(0, range=0..8))
pt_14 = ConstructPoint(XCoordinate=Slider(18, range=0..50), YCoordinate=Slider(29.3, range=0..50), ZCoordinate=Slider(0, range=0..8))
pt_15 = ConstructPoint(XCoordinate=Slider(6.8, range=0..50), YCoordinate=Slider(0.8, range=0..50), ZCoordinate=Slider(0, range=0..8))
intcrv_3 = Interpolate(Vertices=[pt_12, pt_13, pt_14, pt_15, pt_11], Degree=3, Periodic=True, KnotStyle=1)  # -> Curve, Length, Domain

# ---- group: Pontos pé-direito
pt_16 = ConstructPoint(XCoordinate=Slider(32.9, range=0..50), YCoordinate=Slider(5.1, range=0..50), ZCoordinate=Slider(8, range=0..8))
pt_17 = ConstructPoint(XCoordinate=Slider(45.5, range=0..50), YCoordinate=Slider(12.2, range=0..50), ZCoordinate=Slider(8, range=0..8))
pt_18 = ConstructPoint(XCoordinate=Slider(43.2, range=0..50), YCoordinate=Slider(25.3, range=0..50), ZCoordinate=Slider(8, range=0..8))
pt_19 = ConstructPoint(XCoordinate=Slider(34, range=0..50), YCoordinate=Slider(27.9, range=0..50), ZCoordinate=Slider(8, range=0..8))
pt_20 = ConstructPoint(XCoordinate=Slider(23, range=0..50), YCoordinate=Slider(19.2, range=0..50), ZCoordinate=Slider(8, range=0..8))
intcrv_4 = Interpolate(Vertices=[pt_17, pt_18, pt_19, pt_20, pt_16], Degree=3, Periodic=True, KnotStyle=1)  # -> Curve, Length, Domain

# ----
loft = Loft(
    Curves=[intcrv.Curve, intcrv_2.Curve, intcrv_4.Curve, intcrv_3.Curve],
    Options={Adjust=False, Closed=False, LoftEnds=0, LoftSimp=0, LoftType=0, Rebuild=10, Refit=0.01})

# ---- group: Estrutura
script_pra_converter_superficie_em_volum = CSharpScript(enable=Toggle(True), diamTree=loft, d=Slider(0.767, range=0..1))  # -> out, closedBrepTree; "Script pra converter superficie em volume"; inputs enable: Boolean, diamTree: tree of Brep, d: Double
# ---------- script_pra_converter_superficie_em_volum: C# ----------
    if(!enable) return;

    double tol = doc.ModelAbsoluteTolerance; // no need for puzzles: very primitive things here

    DataTree<Brep> diamSolids = new DataTree<Brep>();

    for (int i = 0;i < diamTree.BranchCount;i++){

      Brep diamS = diamTree.Branch(i)[0];
      Array help = diamS.Faces.ToArray();
      int jMax = help.Length;

      for(int j = 0;j < jMax;j++){
        BrepFace diamBRF = diamS.Faces[j];
        bool bothsides = true;
        bool createsolid = true;
        diamSolids.Add(Rhino.Geometry.Brep.CreateFromOffsetFace(diamBRF, d / 2.0, tol, bothsides, createsolid), new GH_Path(i, j));
      }
    }
    closedBrepTree = diamSolids;
# ---------- end script_pra_converter_superficie_em_volum ----------
rectangle = Rectangle(Plane=PlaneXY(0, 0, 0), XSize=Domain(-100, 100), YSize=Domain(-100, 100), Radius=0)  # -> Rectangle, Length
boxrec = BoxRectangle(Rectangle=rectangle.Rectangle, Height=Domain(-20, 0))
mesh = MeshBrep(
    Brep=script_pra_converter_superficie_em_volum.closedBrepTree,
    Settings={GridMaxCount=0, GridMinCount=16, JaggedSeams=False, MaxEdgeLength=0, MinEdgeLength=0.0001, MinTolerance=0, Refine=True, RefineAngle=0, RelativeTolerance=0.65, SimplePlanes=True, Tolerance=0})
mdif = MeshDifference(MeshesA=mesh, MeshesB=boxrec)
box = CenterBox(Base=pt_3, X=Slider(1.947, range=0..50), Y=Slider(9.29, range=0..50), Z=Slider(3.773, range=0..50))
mdif_2 = MeshDifference(MeshesA=mdif, MeshesB=box)
number_slider_2 = Slider(0.185, range=0..1)
Z = UnitZ(Factor=number_slider_2)
script_pra_converter_superficie_em_volum_2 = CSharpScript(enable=Toggle(True), d=number_slider_2)  # -> out, closedBrepTree; "Script pra converter superficie em volume"; inputs enable: Boolean, diamTree: tree of Brep, d: Double; same code as script_pra_converter_superficie_em_volum
extr = Extrude(Direction=Z)
join = BrepJoin(Breps=[script_pra_converter_superficie_em_volum_2.closedBrepTree, extr])  # -> Breps, Closed

# ----
md_slider = MDSlider(
    slider_value=Point(0.7690236161, 0.5185367305, 0.5),
    SliderMode=0,
    x_domain=Domain(0, 60),
    y_domain=Domain(0, 40),
    z_domain=Domain(0, 1))
md_slider_2 = MDSlider(
    slider_value=Point(0.7000002977, 0.143901918, 0.5),
    SliderMode=0,
    x_domain=Domain(0, 60),
    y_domain=Domain(0, 40),
    z_domain=Domain(0, 1))
md_slider_3 = MDSlider(
    slider_value=Point(0.6758541945, 0.718536377, 0.5),
    SliderMode=0,
    x_domain=Domain(0, 60),
    y_domain=Domain(0, 40),
    z_domain=Domain(0, 1))
md_slider_4 = MDSlider(
    slider_value=Point(0.4506091606, 0.5951218024, 0.5),
    SliderMode=0,
    x_domain=Domain(0, 60),
    y_domain=Domain(0, 40),
    z_domain=Domain(0, 1))
md_slider_5 = MDSlider(
    slider_value=Point(0.4024405131, 0.2609759075, 0.5),
    SliderMode=0,
    x_domain=Domain(0, 60),
    y_domain=Domain(0, 40),
    z_domain=Domain(0, 1))
md_slider_6 = MDSlider(
    slider_value=Point(0.1804884003, 0.403049376, 0.5),
    SliderMode=0,
    x_domain=Domain(0, 60),
    y_domain=Domain(0, 40),
    z_domain=Domain(0, 1))
md_slider_7 = MDSlider(
    slider_value=Point(0.7385387886, 0.7620745403, 0.5),
    SliderMode=0,
    x_domain=Domain(0, 60),
    y_domain=Domain(0, 40),
    z_domain=Domain(0, 1))
md_slider_8 = MDSlider(
    slider_value=Point(0.7268304592, 0.0323173709, 0.5),
    SliderMode=0,
    x_domain=Domain(0, 60),
    y_domain=Domain(0, 40),
    z_domain=Domain(0, 1))
offset = Offset(Surface=loft, Distance=Slider(0.43, range=0..1), Retrim=True)
md_slider_9 = MDSlider(
    slider_value=Point(0.844208508, 0.4396347418, 0.5),
    SliderMode=0,
    x_domain=Domain(0, 60),
    y_domain=Domain(0, 40),
    z_domain=Domain(0, 1))
md_slider_10 = MDSlider(
    slider_value=Point(1, 0.4274396199, 0.5),
    SliderMode=0,
    x_domain=Domain(0, 60),
    y_domain=Domain(0, 40),
    z_domain=Domain(0, 1))
pt_21 = Point(md_slider_3)
pt_22 = Point(md_slider)
pt_23 = Point(md_slider_2)
pt_24 = Point(md_slider_3)
pt_25 = Point(md_slider_4)
pt_26 = Point(md_slider_5)
pt_27 = Point(md_slider_6)
pt_28 = Point(md_slider_7)
pt_29 = Point(md_slider_8)
pt_30 = Point(md_slider_9)
pt_31 = Point(md_slider_10)
pt_32 = ConstructPoint(XCoordinate=Slider(18.8, range=0..50), YCoordinate=Slider(6.9, range=0..50), ZCoordinate=0)
pt_33 = ConstructPoint(XCoordinate=Slider(47.1, range=0..50), YCoordinate=Slider(26.7, range=0..50), ZCoordinate=0)
intcrv_5 = Interpolate(Vertices=[pt_23, pt_22, pt_21], Degree=3, Periodic=False, KnotStyle=1)  # -> Curve, Length, Domain
intcrv_6 = Interpolate(Vertices=[pt_26, pt_25, pt_24], Degree=3, Periodic=False, KnotStyle=1)  # -> Curve, Length, Domain
intcrv_7 = Interpolate(Vertices=[pt_21, pt_28, pt_13], Degree=3, Periodic=False, KnotStyle=1)  # -> Curve, Length, Domain
intcrv_8 = Interpolate(Vertices=[pt_26, pt_27, pt_14], Degree=3, Periodic=False, KnotStyle=1)  # -> Curve, Length, Domain
intcrv_9 = Interpolate(Vertices=[pt_12, pt_29, pt_23], Degree=3, Periodic=False, KnotStyle=1)  # -> Curve, Length, Domain
intcrv_10 = Interpolate(Vertices=[pt_22, pt_30, pt_31], Degree=3, Periodic=False, KnotStyle=1)  # -> Curve, Length, Domain
rec_2pt = Rectangle2Pt(Plane=PlaneXY(0, 0, 0), PointA=pt_32, PointB=pt_33, Radius=0)  # -> Rectangle, Length
Z_2 = UnitZ(Factor=3)
srf = Surface(rec_2pt.Rectangle)
offset_2 = Offset(Surface=srf, Distance=Z_2, Retrim=True)
Z_3 = UnitZ(Factor=Slider(15, range=0..15))
join_2 = JoinCurves(Curves=[intcrv_5.Curve, intcrv_6.Curve], Preserve=False)
Z_4 = UnitZ(Factor=Slider(15, range=0..15))
Z_5 = UnitZ(Factor=Slider(15, range=0..15))
Z_6 = UnitZ(Factor=Slider(15, range=0..15))
extr_2 = Extrude(Base=intcrv_7.Curve, Direction=Z_3)
Z_7 = UnitZ(Factor=Slider(15, range=0..15))
extr_3 = Extrude(Base=intcrv_8.Curve, Direction=Z_5)
extr_4 = Extrude(Base=intcrv_9.Curve, Direction=Z_6)
split = SplitBrep(Brep=offset, Cutter=offset_2)  # -> graft(Result)
extr_5 = Extrude(Base=intcrv_10.Curve, Direction=Z_7)
split_2 = SplitBrep(Brep=offset, Cutter=offset_2)  # -> graft(Result)
extr_6 = Extrude(Base=join_2, Direction=Z_4)
split_3 = SplitBrep(Brep=extr_3, Cutter=loft)  # -> graft(Result)
split_4 = SplitBrep(Brep=extr_4, Cutter=loft)  # -> graft(Result)
split_5 = SplitBrep(Brep=extr_5, Cutter=loft)  # -> graft(Result)
split_6 = SplitBrep(Brep=extr_2, Cutter=loft)  # -> graft(Result)
item = CherryPicker(split, ListIndex=0, TreePath_path="{0;0;0}")
item_2 = CherryPicker(split_2, ListIndex=0, TreePath_path="{0;0;1}")
split_7 = SplitBrep(Brep=extr_6, Cutter=loft)  # -> graft(Result)
item_3 = CherryPicker(split_7, ListIndex=0, TreePath_path="{0;0;0;1}")
item_4 = CherryPicker(split_3, ListIndex=0, TreePath_path="{0;0;1}")
item_5 = CherryPicker(split_6, ListIndex=0, TreePath_path="{0;0;1}")
item_6 = CherryPicker(split_4, ListIndex=0, TreePath_path="{0;0;1}")
item_7 = CherryPicker(split_5, ListIndex=0, TreePath_path="{0;0;1}")
script_pra_converter_superficie_em_volum_3 = CSharpScript(enable=Toggle(True), diamTree=item, d=Slider(0.085, range=0..1))  # -> out, closedBrepTree; "Script pra converter superficie em volume"; inputs enable: Boolean, diamTree: tree of Brep, d: Double; same code as script_pra_converter_superficie_em_volum
script_pra_converter_superficie_em_volum_4 = CSharpScript(enable=Toggle(True), diamTree=item_2, d=Slider(0.085, range=0..1))  # -> out, closedBrepTree; "Script pra converter superficie em volume"; inputs enable: Boolean, diamTree: tree of Brep, d: Double; same code as script_pra_converter_superficie_em_volum
mesh_2 = MeshBrep(
    Brep=script_pra_converter_superficie_em_volum_4.closedBrepTree,
    Settings={GridMaxCount=0, GridMinCount=16, JaggedSeams=False, MaxEdgeLength=0, MinEdgeLength=0.0001, MinTolerance=0, Refine=True, RefineAngle=0, RelativeTolerance=0.65, SimplePlanes=True, Tolerance=0})
script_pra_converter_superficie_em_volum_5 = CSharpScript(enable=Toggle(True), diamTree=item_3, d=Slider(0.085, range=0..1))  # -> out, closedBrepTree; "Script pra converter superficie em volume"; inputs enable: Boolean, diamTree: tree of Brep, d: Double; same code as script_pra_converter_superficie_em_volum
script_pra_converter_superficie_em_volum_6 = CSharpScript(enable=Toggle(True), diamTree=item_7, d=Slider(0.085, range=0..1))  # -> out, closedBrepTree; "Script pra converter superficie em volume"; inputs enable: Boolean, diamTree: tree of Brep, d: Double; same code as script_pra_converter_superficie_em_volum
script_pra_converter_superficie_em_volum_7 = CSharpScript(enable=Toggle(True), diamTree=item_6, d=Slider(0.085, range=0..1))  # -> out, closedBrepTree; "Script pra converter superficie em volume"; inputs enable: Boolean, diamTree: tree of Brep, d: Double; same code as script_pra_converter_superficie_em_volum
script_pra_converter_superficie_em_volum_8 = CSharpScript(enable=Toggle(True), diamTree=item_5, d=Slider(0.085, range=0..1))  # -> out, closedBrepTree; "Script pra converter superficie em volume"; inputs enable: Boolean, diamTree: tree of Brep, d: Double; same code as script_pra_converter_superficie_em_volum
script_pra_converter_superficie_em_volum_9 = CSharpScript(enable=Toggle(True), diamTree=item_4, d=Slider(0.085, range=0..1))  # -> out, closedBrepTree; "Script pra converter superficie em volume"; inputs enable: Boolean, diamTree: tree of Brep, d: Double; same code as script_pra_converter_superficie_em_volum
mdif_3 = MeshDifference(MeshesA=mesh_2, MeshesB=box)
join_3 = BrepJoin(Breps=[script_pra_converter_superficie_em_volum_5.closedBrepTree, script_pra_converter_superficie_em_volum_8.closedBrepTree, script_pra_converter_superficie_em_volum_9.closedBrepTree, script_pra_converter_superficie_em_volum_7.closedBrepTree, script_pra_converter_superficie_em_volum_6.closedBrepTree])  # -> Breps, Closed
