# Grasshopper definition study_facade.ghx (Grasshopper 0.9.76)
# plug-ins: Heliotrope, LunchBox

pt = ConstructPoint(XCoordinate=Slider(4.72, range=0..30), YCoordinate=Slider(7.676, range=0..30), ZCoordinate=0)
pt_2 = ConstructPoint(XCoordinate=Slider(4.12, range=0..30), YCoordinate=Slider(15.993, range=0..30), ZCoordinate=0)
pt_3 = ConstructPoint(XCoordinate=Slider(-6.4, range=-10..30), YCoordinate=Slider(21.933, range=0..30), ZCoordinate=0)
intcrv = Interpolate(Vertices=[pt, pt_2, pt_3], Degree=3, Periodic=False, KnotStyle=1)  # -> Curve, Length, Domain
Z = UnitZ(Factor=Slider(2.938, range=0..5))
move = Move(Geometry=intcrv.Curve, Motion=Z)  # -> Geometry, Transform
loft = Loft(
    Curves=[move.Geometry, intcrv.Curve],
    Options={Adjust=False, Closed=False, LoftEnds=0, LoftSimp=0, LoftType=0, Rebuild=10, Refit=0.01})
panel = Panel("""6
12""")
compose = JDayCompose(Year=2000, Month=panel, Day=21, Hour=17, Minute=0, Second=0, UTCOffset=0)
vec = VectorXYZ(XComponent=1, YComponent=-1, ZComponent=0)  # -> Vector, Length
hex = HexagonCells(Surface=loft, UDivisions=Slider(10.256, range=0..50), VDivisions=Slider(27.476, range=0..50), TParameter=0.25)  # -> HexagonCells, Centers
solar_arc = SolarArc(
    JulianDay=compose,
    Latitude=0,
    Longitude=0,
    North=vec.Vector,
    Origin=Point(0, 0, 0),
    ScaleArc=Slider(17.434, range=0..30),
    ScaleSun=Slider(1.21, range=0..30),
    Offset=[Slider(0.66, range=0..1), Slider(0.84, range=0..1)])  # -> SolarArc, Sun, graft(SolarVector), TimeOfDay
item = CherryPicker(solar_arc.SolarVector, ListIndex=0, TreePath_path="{0;0}")
item_2 = CherryPicker(solar_arc.SolarVector, ListIndex=0, TreePath_path="{0;1}")
cast = CastSilhouette(BRep=loft, SolarVector=item_2, Plane=PlaneXY(0, 0, 0))  # -> Projection, Silhouette, Front
genes = GenePool(Decimals=1, Maximum=1, Minimum=0.1, Value=[0.1, 0.1, 0.2, 0.1, 0.1, 0.2, 0.2, 0.3, 0.1, 0.1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])
scale = Scale(Geometry=hex.HexagonCells, Center=hex.Centers, Factor=genes)  # -> Geometry, Transform
fpatch = FragmentPatch(Boundary=scale.Geometry)
cast_2 = CastSilhouette(BRep=loft, SolarVector=item, Plane=PlaneXY(0, 0, 0))  # -> Projection, Silhouette, Front
cast_3 = CastSilhouette(BRep=fpatch, SolarVector=item, Plane=PlaneXY(0, 0, 0))  # -> Projection, Silhouette, Front
cast_4 = CastSilhouette(BRep=fpatch, SolarVector=item_2, Plane=PlaneXY(0, 0, 0))  # -> Projection, Silhouette, Front
area = Area(Geometry=cast_3.Silhouette)  # -> Area, Centroid
area_2 = Area(Geometry=cast_4.Silhouette)  # -> Area, Centroid
ma = MassAddition(Input=area_2.Area)  # -> Result, PartialResults
ma_2 = MassAddition(Input=area.Area)  # -> Result, PartialResults
panel_2 = Panel(ma.Result)
panel_3 = Panel(ma_2.Result)
galapagos = Galapagos(fitness=division, gene=genes)
division = Division(A=panel_3, B=panel_2)
panel_4 = Panel(division)
